# Grasshopper definition KVP-Monitor.gh (Grasshopper 1.0.7)
# plug-ins: Simulacrum, VirtualRobot.Grasshopper

kr_210 = Panel("192.168.40.129")
panel = Panel("192.168.102.128")
client = TCPClient(ServerIP=kr_210, ServerPort="7000", ConnectionTrigger=Toggle(True))
toggle = BooleanToggle(True)

# ---- group: Read Values
read_position = ReadActPos(Socket=client, Run=toggle, RefreshRate="50")  # -> AxisValues, TCPPlane, XYZ, ABC, E6POS, E6AXIS
num = Number(read_position.AxisValues)
pln = Plane(read_position.TCPPlane)

# ----
monitor = NetstatMonitor(Socket=client)

# ---- group: Read target frame
krc_read = KRCRead(Socket=client, VarRead="MyPos", ReadTrigger=toggle, RefreshRate=100)
ghpython_script = GhPythonScript(iPos=krc_read)  # -> out, XYZ, ABC
# ---------- ghpython_script: Python ----------
def GetValue(txt, c):
    pos = txt.find(c) + 2
    length = len(txt)
    return txt[pos:length]

if (iPos != None and iPos != ""):
    length = len(iPos)
    trunc = iPos[1:length-1] 
    txt = trunc.split(",")
    x = GetValue(txt[0], "X")
    y = GetValue(txt[1], "Y")
    z = GetValue(txt[2], "Z")
    a = GetValue(txt[3], "A")
    b = GetValue(txt[4], "B")
    c = GetValue(txt[5], "C")
    
    #print(c)
    XYZ = "{" + x + ", " + y + "," + z + "}"
    ABC = "{" + a + ", " + b + "," + c + "}"
# ---------- end ghpython_script ----------
sframe = SetFrame(XYZLocation=ghpython_script.XYZ, ABCOrientation=ghpython_script.ABC)

# ---- group: Read variable
krc_read_2 = KRCRead(Socket=client, VarRead="STATE", ReadTrigger=toggle, RefreshRate=100)
panel_2 = Panel(krc_read_2)

# ---- group: Check Connection
panel_3 = Panel(monitor)

# ----
panel_4 = Panel(krc_read)
panel_5 = Panel(read_position.AxisValues)
kuka_kr_210 = PredefinedKUKAKR210Robot(RobRootFrame=PlaneXY(0, 0, 0), variant="R2700")
robot_fk = RobotForwardKinematics(Robot=kuka_kr_210, AxisValues=num, useColorPreview=True)  # -> PoseGeometry, TCPFrame, AxisFrames

# ---- group: Kuka Datatype Converter
converter = Converter(E6POS=read_position.E6POS, E6AXIS=read_position.E6AXIS)  # -> E6POSNames, E6POSValues, E6AXISNames, E6AXISValues, FRAMENames, FRAMEValues
panel_6 = Panel(converter.E6POSNames)
panel_7 = Panel(converter.E6POSValues)
