# Grasshopper definition RobotTargets.gh (Grasshopper 1.0.7)
# plug-ins: VirtualRobot.Grasshopper

# ---- group: Calibration
origin = Point(Point(2807.19, -1250.03, 41.94))
xdir = Point(Point(3014.23, -1501.96, 803.2))
ydir = Point(Point(2213.62, -1759.37, 38.84))

# ---- group: Canvas
width = Panel("1000")
height = Panel("1000")
construct_domain = ConstructDomain(DomainStart=0, DomainEnd=width)
construct_domain_2 = ConstructDomain(DomainStart=0, DomainEnd=height)
rectangle = Rectangle(Plane=PlaneXY(0, 0, 0), XSize=construct_domain, YSize=construct_domain_2, Radius=0)  # -> Rectangle, Length
canvas = Rectangle(rectangle.Rectangle)

# ---- group: Generate Targets
canvas_2 = Rectangle(canvas)
force = Slider(281, range=1..1000)
curve = Curve(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)
point_count = Slider(60, range=1..100)
populate_2d = Populate2D(Region=canvas_2, Count=point_count, Seed=1)
curve_closest_point = CurveClosestPoint(Point=populate_2d, Curve=curve)  # -> Point, Parameter, Distance
vector_2pt = Vector2Pt(PointA=populate_2d, PointB=curve_closest_point.Point, Unitize=Toggle(True))  # -> Vector, Length
bounds = Bounds(Numbers=curve_closest_point.Distance)
remap_numbers = RemapNumbers(Value=curve_closest_point.Distance, Source=bounds, Target=Domain(0, 1))  # -> Mapped, Clipped
graph_mapper = GraphMapper(
    remap_numbers.Mapped,
    x0=0,
    x1=1,
    y0=0,
    y1=1,
    container_name="Bezier",
    cpx=[0, 0.3294326961, 0.1552128345, 1],
    cpy=[0, 1, 1, 1])
multiplication = Multiplication(A=force, B=graph_mapper)
amplitude = Amplitude(Vector=vector_2pt.Vector, Amplitude=multiplication)
move = Move(Geometry=populate_2d, Motion=amplitude)  # -> Geometry, Transform
point = Point(move.Geometry)

# ---- group: Robot System
xy_plane = XYPlane(Origin=Point(0, 0, 0))
mesh = Mesh([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])
point_2 = Point(Point(33.30061319, 128.973053, 114.296916))
xz_plane = XZPlane(Origin=point_2)
flip_plane = FlipPlane(Plane=xz_plane, ReverseX=Toggle(True), ReverseY=Toggle(False), SwapAxes=True)
define_end_effector = DefineEndEffector(Geometry=mesh, TCPFrame=flip_plane, MountingFrame=PlaneXY(0, 0, 0))
predefined_kuka_kr_210_robot = PredefinedKUKAKR210Robot(RobRootFrame=xy_plane, EndEffectorOptional=define_end_effector, variant="R2700")

# ---- group: Calibration
plane_fit = PlaneFit(Points=[origin, xdir, ydir])  # -> Plane, Deviation
vector_2pt_2 = Vector2Pt(PointA=origin, PointB=xdir, Unitize=False)  # -> Vector, Length
plane_origin = PlaneOrigin(Base=plane_fit.Plane, Origin=origin)
align_plane = AlignPlane(Plane=plane_origin, Direction=vector_2pt_2.Vector)  # -> Plane, Angle
flip_plane_2 = FlipPlane(Plane=align_plane.Plane, ReverseX=False, ReverseY=True, SwapAxes=True)
workpiece = Plane(flip_plane_2)

# ---- group: Reorient Targets
xy_plane_2 = XYPlane(Origin=Point(0, 0, 0))
orient = Orient(Geometry=canvas, Source=xy_plane_2, Target=workpiece)  # -> Geometry, Transform
orient_2 = Orient(Geometry=point, Source=xy_plane_2, Target=workpiece)  # -> Geometry, Transform
point_3 = Point(orient_2.Geometry)

# ----
point_4 = Point(Point(2328.37, -1346.63, 727.19))
plane = Plane(workpiece)

# ---- group: Preview
rectangle_2 = Rectangle(orient.Geometry)
point_5 = Point(point_3)
mesh_plane = MeshPlane(Boundary=rectangle_2, WidthCount=10, HeightCount=10)  # -> Mesh, Area
custom_preview = CustomPreview(Geometry=mesh_plane.Mesh, Material=ColourSwatch(SwatchColor=RGB(54, 54, 54)))
dot_display = DotDisplay(Point=point_5, Colour=ColourSwatch(SwatchColor=RGBA(255, 255, 255, 146)), Size=50)

# ----
vector_2pt_3 = Vector2Pt(PointA=point_3, PointB=point_4, Unitize=False)  # -> Vector, Length
plane_origin_2 = PlaneOrigin(Base=plane, Origin=point_4)
flip_plane_3 = FlipPlane(Plane=plane_origin_2, ReverseX=True, ReverseY=True, SwapAxes=False)
deconstruct_plane = DeconstructPlane(Plane=flip_plane_3)  # -> Origin, XAxis, YAxis, ZAxis
adjust_plane = AdjustPlane(Plane=flip_plane_3, Normal=vector_2pt_3.Vector)
align_plane_2 = AlignPlane(Plane=adjust_plane, Direction=deconstruct_plane.XAxis)  # -> Plane, Angle
list_item = ListItem(List=align_plane_2.Plane, Index=Slider(14, range=0..19), Wrap=True)
get_frame = GetFrame(Frame=list_item)  # -> XYZLocation, ABCOrientation
len = Number(vector_2pt_3.Length)
robot_inverse_kinematics = RobotInverseKinematics(Robot=predefined_kuka_kr_210_robot, TargetTCPFrame=list_item, AxisToggles=[False, False, False], useColorPreview=True)  # -> PoseGeometry, AxisValues, AxisFrames
custom_preview_2 = CustomPreview(Geometry=robot_inverse_kinematics.PoseGeometry, Material=ColourSwatch(SwatchColor=RGBA(92, 92, 92, 160)))
